# Grasshopper definition example_usage.gh (Grasshopper 1.0.7)

number_slider = Slider(36, range=0..100)
input = DataInput(
    Destination="/Volumes/GoogleDrive/Shared drives/CONTEXTMACHINE/PROJECTS/2202_Lahta_Arc/Lahta Arc_WORK/MM/gh_data/hyp_panels_production_data.ghdata",
    RelativePath="/Volumes/GoogleDrive/Shared drives/CONTEXTMACHINE/PROJECTS/2202_Lahta_Arc/Lahta Arc_WORK/MM/gh_data/hyp_panels_production_data.ghdata|../../../../Volumes/GoogleDrive/Shared drives/CONTEXTMACHINE/PROJECTS/2202_Lahta_Arc/Lahta Arc_WORK/MM/gh_data/hyp_panels_production_data.ghdata",
    UpdateDelay=50000)  # -> Hyp_panels_surf_6x2_row, Hyp_panels_names, Hyp_panels_cogs_rule, Hyp_panels_pins_pt, Hyp_panels_check_mark_pt, Hyp_panels_mep_pt, Hyp_panels_mep_tag, Hyp_panels_mep_r, thermal_seam_plate, thermal_seam_plate_holes_pt
dumps = Dumps()  # -> a
# ---------- dumps: Python ----------
__author__ = "andrewastakhov"

import rhinoscriptsyntax as rs

import gh_namespaces
a=gh_namespaces.dumps(pyObj)
# ---------- end dumps ----------
python = GhPythonScript(x=input.Hyp_panels_cogs_rule, y=input.Hyp_panels_names)  # -> out, a
# ---------- python: Python ----------
__author__ = "andrewastakhov"

import rhinoscriptsyntax as rs

"""Provides a scripting component.
    Inputs:
        x: The x script variable
        y: The y script variable
    Output:
        a: The a output variable"""

__author__ = "andrewastakhov"

PACKAGE_DIR="/Users/andrewastakhov/PycharmProjects/lahta"
import sys 
import os
sys.path.extend([PACKAGE_DIR])
import gh_namespaces
from gh_namespaces.namespace import Namespace
import pprint

    
    
a=Namespace(ghenv.Component, globals())
print a
# ---------- end python ----------
ns = Namespace(k1=input.Hyp_panels_cogs_rule, k2=input.Hyp_panels_names)  # -> out, pyObj
# ---------- ns: Python ----------
import sys 
import os
sys.path.extend([os.getenv("PACKAGE_DIR")])

import gh_namespaces
from gh_namespaces.namespace import Namespace
import pprint

pyObj=Namespace(ghenv.Component, globals())
pprint.pprint(pyObj)
# ---------- end ns ----------
env = Env()  # -> out, a; inputs upd: Boolean
# ---------- env: Python ----------
__author__ = "andrewastakhov"
import json
import rhinoscriptsyntax as rs
import os
import sys
import pprint
PREFIX="/cxm/lahta" 
if upd:
    os.environ['PACKAGE_DIR']  = "{}{}".format(os.getenv("HOME"), PREFIX) if os.name == "posix" else "%homedrive%%homepath%"+PREFIX
    sys.path.extend([os.environ['PACKAGE_DIR']])
    pprint.pprint( os.environ)
# ---------- end env ----------
getter = Getter(pyObj=python.a, key="x")  # -> value
# ---------- getter: Python ----------
import sys 
import os
value=pyObj[key]
# ---------- end getter ----------
ns_2 = Namespace()  # -> out, pyObj; same code as ns
dumps_2 = Dumps(pyObj=ns.pyObj)  # -> a; same code as dumps
panel = Panel(dumps_2)
